# Grasshopper definition UnityReceiver.gh (Grasshopper 1.0.7)
# plug-ins: Robots

init = Button()
pt = Point(Point(504.6680807, 0, 233.4831237))
pt_2 = Point(Point(578.6177642, -50.88953005, 440.3286886))
c_script = CSharpScript(init=init)  # -> Data, Position, Rotation; inputs init: Boolean
# ---------- c_script: C# usings ----------
using Grasshopper.Kernel.Special;
using Grasshopper.GUI.Canvas;
# ---------- c_script: C# ----------
    if(forceUpdate || init)
    {
      using(var args = new Rhino.Runtime.NamedParametersEventArgs())
      {
        Component.PingDocument -= OnPingDocument;
        Component.PingDocument += OnPingDocument;
        Component.ObjectChanged -= OnObjectChanged;
        Component.ObjectChanged += OnObjectChanged;
        Grasshopper.Instances.ActiveCanvas.DocumentChanged -= OnDocumentChanged;
        Grasshopper.Instances.ActiveCanvas.DocumentChanged += OnDocumentChanged;

        args.Set("id", Component.InstanceGuid.ToString());
        Rhino.Runtime.HostUtils.ExecuteNamedCallback("FromGHData", args);

        Register(Component);
      }

      forceUpdate = false;
    }

    Data = dataValue;
    Position = posValue;
    Rotation = rotValue;
# ---------- c_script: C# additional code ----------
  string dataValue = "";
  Vector3d posValue;
  Vector3d rotValue;

  IGH_Component comp = null;

  bool forceUpdate = false;

  void Register(IGH_Component component)
  {
    Rhino.Runtime.HostUtils.RegisterNamedCallback("ToGH_Position_" + Component.InstanceGuid.ToString(), ToGrasshopper);
    Rhino.Runtime.HostUtils.RegisterNamedCallback("ToGH_Rotation_" + Component.InstanceGuid.ToString(), ToGrasshopper);

    comp = component;
  }

  void ToGrasshopper(object sender, Rhino.Runtime.NamedParametersEventArgs args)
  {
    Vector3d position;
    Vector3d rotation;

    if (args.TryGetVector("position", out position))
    {
      posValue = new Vector3d(position.X, position.Z, position.Y);
    }
    if (args.TryGetVector("rotation", out rotation))
    {
      rotValue = new Vector3d(rotation.X, rotation.Z, rotation.Y);
    }

    comp.ExpireSolution(true);
  }

  public void OnPingDocument(object sender, GH_PingDocumentEventArgs e){
    if(e.Document == null){
      using(var args = new Rhino.Runtime.NamedParametersEventArgs()){
        args.Set("id", comp.InstanceGuid.ToString());
      }
    }
  }

  public void OnObjectChanged(object sender, GH_ObjectChangedEventArgs e){
    if(e.Type == GH_ObjectEventType.Enabled){
      if(comp.Locked){
        using(var args = new Rhino.Runtime.NamedParametersEventArgs()){
          forceUpdate = true;
          args.Set("id", comp.InstanceGuid.ToString());
        }
      }
    }

    comp.ExpireSolution(true);
  }

  public void OnDocumentChanged(object sender, GH_CanvasDocumentChangedEventArgs e){
    using(var args = new Rhino.Runtime.NamedParametersEventArgs()){
      args.Set("id", comp.InstanceGuid.ToString());

      forceUpdate = true;

      if(comp != null){
        comp.ExpireSolution(true);
      }
    }
  }
# ---------- end c_script ----------
xy = XYPlane(Origin=pt_2)
xy_2 = XYPlane(Origin=pt)
pt2num = PointsToNumbers(Points=c_script.Position, Mask=4)
pt2num_2 = PointsToNumbers(Points=c_script.Rotation, Mask=4)
pflip = FlipPlane(Plane=xy, ReverseX=False, ReverseY=False, SwapAxes=True)
pflip_2 = FlipPlane(Plane=xy_2, ReverseX=False, ReverseY=False, SwapAxes=True)
rad = Radians(Degrees=pt2num_2)
merge = Merge(Data1=pt2num, Data2=rad)  # -> flatten(Result)
list = RobotsLibrary({"TUDelft-LAMA-UR5 (missing)": "TUDelft-LAMA-UR5"}, selected="TUDelft-LAMA-UR5 (missing)", Type=0)
panel = Panel(merge)
loadrobot = LoadRobotSystem(Name=list, Base=PlaneXY(0, 0, 0))
getplane = GetPlane(Numbers=merge, RobotSystem=loadrobot)
list_2 = FlagFields({"Shoulder": 1, "Elbow": 2, "Wrist": 4}, selected="Shoulder")
list_3 = FlagFields({"Shoulder": 1, "Elbow": 2, "Wrist": 4}, selected=[])
getplane_2 = GetPlane(Numbers=merge, RobotSystem=loadrobot)
target = CreateTarget(Plane=getplane_2, RobConf=list_3, IsCartesian=True)
target_2 = CreateTarget(Plane=[pflip, pflip_2, getplane], RobConf=list_2, IsCartesian=True)
init_2 = Button()
program = CreateProgram(Name="DefaultProgram", RobotSystem=loadrobot, Targets=target_2, StepSize=1)  # -> Program, Code, Duration, Warnings, Errors, JSON
c_script_2 = CSharpScript()  # inputs init: Boolean, N: String, R: String, T: String
# ---------- c_script_2: C# usings ----------
using Grasshopper.Kernel.Special;
using Grasshopper.GUI.Canvas;
using Grasshopper.Plugin;
# ---------- c_script_2: C# ----------
    if(forceUpdate || init)
    {
      using(var args = new Rhino.Runtime.NamedParametersEventArgs())
      {
        Component.PingDocument -= OnPingDocument;
        Component.PingDocument += OnPingDocument;
        Component.ObjectChanged -= OnObjectChanged;
        Component.ObjectChanged += OnObjectChanged;
        Grasshopper.Instances.ActiveCanvas.DocumentChanged -= OnDocumentChanged;
        Grasshopper.Instances.ActiveCanvas.DocumentChanged += OnDocumentChanged;

        args.Set("id", Component.InstanceGuid.ToString());
        args.Set("N", nValue);
        args.Set("R", rValue);
        args.Set("T", tValue);
        args.Set("C", cValue);
        args.Set("I", iValue);
        args.Set("S", sValue);
        Rhino.Runtime.HostUtils.ExecuteNamedCallback("FromGHClearUI", args);
        Rhino.Runtime.HostUtils.ExecuteNamedCallback("FromGHData", args);

        Register(Component);
      }

      forceUpdate = false;
    }
    if(N != null)
      nValue = N.ToString();
    if(R != null)
      rValue = R.ToString();
    if(T != null)
      tValue = T.ToString();
    if(C != null)
      cValue = C.ToString();
    if(I != null)
      iValue = I.ToString();
    if(S != null)
      sValue = S.ToString();
# ---------- c_script_2: C# additional code ----------
  string nValue = "", rValue = "", tValue = "", cValue = "", iValue = "", sValue = "";

  IGH_Component comp = null;

  bool forceUpdate = false;

  void Register(IGH_Component component)
  {
    comp = component;
  }

  public void OnPingDocument(object sender, GH_PingDocumentEventArgs e){
    if(e.Document == null){
      using(var args = new Rhino.Runtime.NamedParametersEventArgs()){
        args.Set("id", comp.InstanceGuid.ToString());
        args.Set("N", nValue);
        args.Set("R", rValue);
        args.Set("T", tValue);
        args.Set("C", cValue);
        args.Set("I", iValue);
        args.Set("S", sValue);
        Rhino.Runtime.HostUtils.ExecuteNamedCallback("FromGHClearUI", args);
      }
    }
  }

  public void OnObjectChanged(object sender, GH_ObjectChangedEventArgs e){
    if(e.Type == GH_ObjectEventType.Enabled){
      if(comp.Locked){
        using(var args = new Rhino.Runtime.NamedParametersEventArgs()){
          forceUpdate = true;
          args.Set("id", comp.InstanceGuid.ToString());
          args.Set("N", nValue);
          args.Set("R", rValue);
          args.Set("T", tValue);
          args.Set("C", cValue);
          args.Set("I", iValue);
          args.Set("S", sValue);
          Rhino.Runtime.HostUtils.ExecuteNamedCallback("FromGHClearUI", args);
        }
      }
    }

    comp.ExpireSolution(true);
  }

  public void OnDocumentChanged(object sender, GH_CanvasDocumentChangedEventArgs e){
    using(var args = new Rhino.Runtime.NamedParametersEventArgs()){
      args.Set("id", comp.InstanceGuid.ToString());
      args.Set("N", nValue);
      args.Set("R", rValue);
      args.Set("T", tValue);
      args.Set("C", cValue);
      args.Set("I", iValue);
      args.Set("S", sValue);
      Rhino.Runtime.HostUtils.ExecuteNamedCallback("FromGHClearUI", args);

      forceUpdate = true;

      if(comp != null){
        comp.ExpireSolution(true);
      }
    }
  }
# ---------- end c_script_2 ----------
c_script_3 = CSharpScript(init=init_2, json=program.JSON)  # inputs init: Boolean, json: String
# ---------- c_script_3: C# ----------
    if(json != jsonValue)
    {
      jsonValue = json;
      forceUpdate = true;
    }

    if(forceUpdate || init)
    {
      using(var args = new Rhino.Runtime.NamedParametersEventArgs())
      {
        Component.PingDocument -= OnPingDocument;
        Component.PingDocument += OnPingDocument;
        Component.ObjectChanged -= OnObjectChanged;
        Component.ObjectChanged += OnObjectChanged;
        Grasshopper.Instances.ActiveCanvas.DocumentChanged -= OnDocumentChanged;
        Grasshopper.Instances.ActiveCanvas.DocumentChanged += OnDocumentChanged;

        args.Set("id", Component.InstanceGuid.ToString());
        args.Set("json", jsonValue);

        Rhino.Runtime.HostUtils.ExecuteNamedCallback("FromGHClearUI", args);
        Rhino.Runtime.HostUtils.ExecuteNamedCallback("FromGHData", args);

        Register(Component);
      }

      forceUpdate = false;
    }

    if(json != null)
      jsonValue = json.ToString();
# ---------- c_script_3: C# additional code ----------
  string jsonValue = "";

  IGH_Component comp = null;

  bool forceUpdate = false;

  void Register(IGH_Component component)
  {
    comp = component;
  }

  public void OnPingDocument(object sender, GH_PingDocumentEventArgs e){
    if(e.Document == null){
      using(var args = new Rhino.Runtime.NamedParametersEventArgs()){
        args.Set("id", comp.InstanceGuid.ToString());
        args.Set("json", jsonValue);
        Rhino.Runtime.HostUtils.ExecuteNamedCallback("FromGHClearUI", args);
        Rhino.Runtime.HostUtils.ExecuteNamedCallback("FromGHData", args);
      }
    }
  }

  public void OnObjectChanged(object sender, GH_ObjectChangedEventArgs e){
    if(e.Type == GH_ObjectEventType.Enabled){
      if(comp.Locked){
        using(var args = new Rhino.Runtime.NamedParametersEventArgs()){
          forceUpdate = true;
          args.Set("id", comp.InstanceGuid.ToString());
          args.Set("json", jsonValue);
          Rhino.Runtime.HostUtils.ExecuteNamedCallback("FromGHClearUI", args);
          Rhino.Runtime.HostUtils.ExecuteNamedCallback("FromGHData", args);
        }
      }
    }

    comp.ExpireSolution(true);
  }

  public void OnDocumentChanged(object sender, GH_CanvasDocumentChangedEventArgs e){
    using(var args = new Rhino.Runtime.NamedParametersEventArgs()){
      args.Set("id", comp.InstanceGuid.ToString());
      args.Set("json", jsonValue);
      Rhino.Runtime.HostUtils.ExecuteNamedCallback("FromGHClearUI", args);
      Rhino.Runtime.HostUtils.ExecuteNamedCallback("FromGHData", args);

      forceUpdate = true;

      if(comp != null){
        comp.ExpireSolution(true);
      }
    }
  }
# ---------- end c_script_3 ----------
panel_2 = Panel(program.Warnings)
panel_3 = Panel(program.Errors)
sim = ProgramSimulation(Program=program.Program, Time=Slider(0, range=0..1), Normalized=True)  # -> SystemMeshes, JointRotations, Plane, Index, Time, Program, Errors
